vi "Rx_main.gvi"   [LabVIEW NXG]
panel controls:
  "IQ rate": f64 = 500000
  "carrier frequency": f64 = 2450000000
  "gain": f64 = 10
  "PSK type": enum{"normal", "shifted", "offset"} = "normal"
  "samples per symbol": i32 = 16
  "M-PSK": i32 = 4
  "modulation type": T1 = "PSK"
  "pulse shaping filter": T2 = "Root Raised Cos"
  "filter parameter": f64 = 0.5
  "stopFetchingLoop": bool
  "packet_size_with_padding": f64 = 10624
  "wanted_sync_index": f64 = 60
  "correction": f64 = 0.02
  "multiple": f64 = 10000
  "soundSamplesPerPacket": i32 = 128
  "bitsPerSample": i32 = 8
  "uLaw": bool
  "CheckMatrixLocation": path
  "LDPC": bool
  "itMax": i32
panel indicators:
  "Sync_Found?": bool
  "Sync_Index": f64
  "Demodulated IQ Graph": T3[]
  "SoundOutput": waveform<f64>[]
types:
  T1 = enum{"FSK", "PSK", "QAM", "MSK", "PAM", "ASK", "CPM"}
  T2 = enum{"none", "Raised Cosine", "Root Raised Cos", "Gaussian"}
  T3 = cluster{"constellation": f64[], "oversampled data": f64[]}
  T4 = cluster{"sample rate": f64, "number of channels": i32, "bits per sample": i32}
  T5 = cluster{"samples per symbol (16)": i32, "symbol map": c128[], "differential PSK": enum{"disable", "enable"}, "PSK type": enum{"normal", "shifted", "offset"}}
  T6 = cluster{"expected sync location (symbols)": i32, "sync sequence": c128[], "sync location uncertainty (symbols)": i32, "sync indent (symbols)": i32}
  T7 = cluster{"psk_system_params": T5, "pulse_shaping_filter_coeffs": f64[], "matched_filter_coeffs": f64[], "sync_params": T6, "sync_seq_bits": i8[]}
diagram:
  w1 = T4 {"sample rate"=6000, "number of channels"=1, "bits per sample"=8}
  w2 = $wanted_sync_index
  w3 = $packet_size_with_padding
  w4 = $soundSamplesPerPacket
  w5 = $bitsPerSample
  w6 = $correction
  w7 = $multiple
  call "initPSK.gvi"(PSK type=$"PSK type", samples per symbol=$"samples per symbol", M-PSK=$"M-PSK", modulation type=$"modulation type", pulse shaping filter=$"pulse shaping filter", filter parameter=$"filter parameter", PSK_params_in=T7 {all zero or empty}) -> (PSK_params_out=w8)
  call "Sound Output Configure.gvi"(device ID=0, sound format=w1, number of samples per channel=8000) -> (task ID=w9, error out=w10)
  call "Sound Output Start.gvi"(task ID=w9, error in=w10) -> (task ID out=w11, error out=w12)
  call "Read from Spreadsheet File (DBL).gvi"(file path=$CheckMatrixLocation, format="%.3f", delimiter=",") -> (all rows=w13)
  call "niUSRP Open Rx Session.gvi"(Device names="192.168.10.2") -> (Error Out=w14, Session handle=w15)
  call "niUSRP Configure Signal.gvi"(session handle=w15, IQ rate=$"IQ rate", carrier frequency=$"carrier frequency", gain=$gain, error in (no error)=w14, active antenna="RX1") -> (session handle out=w16, Error Out=w17)
  call "niUSRP Initiate.gvi"(session handle=w16, error in (no error)=w17) -> (session handle out=w18, Error Out=w19)
  w20 = cluster{"t0": f64, "dt": f64, "Y": c128[]} {all zero or empty}
  s1 = w20  # shift register
  s2 = uninitialised  # shift register
  s3 = uninitialised  # shift register
  while (iteration -> i1) {
    call "demodulation_block.gvi"(data=s1, PSK_params_in=w8) -> (output bit stream=w21, recovered complex waveform=w22, Sync_Found?=w23, sync found index=w24)
    Is Greater Than 0(x=i1) -> w25
    case (w25) {
      frame False, Default {
        w26 = w3
        w27 = w18
        w28 = w19
      }
      frame True {
        Not(x=w25) -> w29
        call "adjust_Samples_to_sync.gvi"(wanted_sync_index=w2, current_sync_index=w24, packet_size_with_padding=w3, first_interation?=w29, sync_location_last_iteration=s2, samples_last_interation=s3) -> (new_NumOfSamples=w26)
        w27 = w18
        w28 = w19
      }
    }
    To Unsigned Quad Integer(number=w26) -> w30
    call "niUSRP Fetch Rx Data (CDB Cluster).gvi"(session handle=w27, number of samples=w30, error in (no error)=w28) -> (session handle out=w31, data=w32, Error Out=w33)
    Multiply(w4, w5) -> w34
    case ($LDPC) {
      frame False, Default {
        call "extractDataBits.gvi"(appendedArray=w21, dataBitsPerPacket=w34) -> (dataArray=w35)
      }
      frame True {
        Multiply(2, w34) -> w36
        call "extractDataBits.gvi"(appendedArray=w21, dataBitsPerPacket=w36) -> (dataArray=w37)
        call "ldpcDecoding.gvi"(ReceivedMessage=w37, CheckMatrix=w13, itMax=$itMax) -> (MesageDecoded=w35)
      }
    }
    call "soundBitStream2Integer.gvi"(bitStream=w35, numberOfSoundSamples=w4, bitsPerSample=w5) -> (integerArray=w38)
    case ($uLaw) {
      frame False, Default {
        To Double Precision Float(number=w38) -> w39
      }
      frame True {
        call "uLawDecodeArray8to16bits.gvi"(X=w38) -> (Y=w39)
      }
    }
    call "deShiftAndMultSoundArray.gvi"(unprocessedSoundArray=w39, correction=w6, multiple=w7) -> (processedArray=w40)
    Property Node(instance in=w1) -> ("sample rate"=w41)
    Reciprocal(x=w41) -> w42
    Build Waveform Node(Y=w40, dt=w42, t0=1904-01-01T00:00:00Z) -> (output waveform=w43)
    Build Array(w43, waveform<f64> {dt=1, Y=[]}) -> w44
    call "Sound Output Write.gvi"(task ID=w11, data=w44, error in=w12) -> (task ID out=w45, error out=w46)
    $"Sync_Found?" <- w23
    $Sync_Index <- w24
    $SoundOutput <- w44
    call "MT Format Constellation.gvi"(waveform=w22) -> (constellation graph=w47)
    $"Demodulated IQ Graph" <- w47
    next s1 = w32
    next s2 = w24
    next s3 = w26
    stop if $stopFetchingLoop
  }
  call "niUSRP Abort.gvi"(Handle in=w31, error in (no error)=w33) -> (Handle out=w48, Error Out=w49)
  call "niUSRP Close Session.gvi"(Handle in=w48, error in (no error)=w49)
  call "Sound Output Stop.gvi"(task ID=w45, error in=w46) -> (task ID out=w50, error out=w51)
  call "Sound Output Clear.gvi"(task ID=w50, error in=w51)
